# Grasshopper definition eleni_workshop.gh (Grasshopper 1.0.7)

panel = Panel("/Users/ziqwang/Documents/GitHub/Scaffold/data/multi_tangent_data/mt_results/eleni_layer_0_legacy.json")
geometry = Geometry(flatten(Tree({0;0}: [Line((0.1335411173, 0, 0), (-0.08902741151, 0.099535672, 0.08127053587))], {0;1}: [Line((0.1335411173, 0, 0), (-0.01483790192, -0.1327142293, 0.1625410717))], {0;2}: [Line((0.1335411173, 0, 0), (0.1088112807, 0.07741663378, 0.2438116076))], {0;3}: [Line((-0.08902741151, 0.099535672, 0.08127053587), (-0.01483790192, -0.1327142293, 0.1625410717))], {0;4}: [Line((-0.08902741151, 0.099535672, 0.08127053587), (0.1088112807, 0.07741663378, 0.2438116076))], {0;5}: [Line((-0.08902741151, 0.099535672, 0.08127053587), (-0.1302438057, 0.02949205096, 0.3250821435))]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)))
crv = Curve(<curve referenced from the Rhino model>)
crv_2 = Curve([<curve referenced from the Rhino model> x15])
crv_3 = Curve([<curve referenced from the Rhino model> x11])
crv_4 = Curve(geometry)
group = Group(Objects=crv_2)
group_2 = Group(Objects=crv_3)
group_3 = Group(Objects=[group, group_2])
L = GhPythonScript(file_path=panel)  # -> lines, coupler_planes
# ---------- L: Python ----------
import json
import ghpythonlib.components as gh
import Rhino.Geometry.Plane as Plane
import Rhino.Geometry.Vector3d as Vector3d
import Rhino.Geometry.Point3d as Point3d

with open(file_path) as json_data:
    data = json.load(json_data)

ps = data['line_pt_pairs']
lines = []
for p0,p1 in ps:
    a = gh.ConstructPoint(*p0)
    b = gh.ConstructPoint(*p1)
    a *= scale
    b *= scale
    lines.append(gh.Line(a, b))

coupler_planes = []
xyz = [0, 1, 2]
for coupler_data in data['half_couplers']:
    tform = coupler_data['pose']
    plane = Plane(Point3d(*[tform[3][i] * scale for i in xyz]),
                  Vector3d(*[tform[1][i] for i in xyz]),
                  Vector3d(*[tform[0][i] for i in xyz])
                  )
    coupler_planes.append(plane)
# ---------- end L ----------
# Send
python = GhPythonScript(lines=crv_4, radius="0.01", file_name="eleni", fixed_lines=crv, button=Button())  # inputs lines: list of Curve, fixed_lines: list of Curve, button: Boolean
# ---------- python: Python ----------
import time
import ghpythonlib.components as gh
from compas_eve import Message
from compas_eve import Publisher
from compas_eve import Topic
from compas_eve.mqtt import MqttTransport


def get_line_id(line, lines):
    [p0, p1] = gh.EndPoints(line)
    
    for id, l in enumerate(lines):
        [q0, q1] = gh.EndPoints(l)
        dist0 = gh.Distance(p0, q0) + gh.Distance(p1, q1)
        dist1 = gh.Distance(p1, q0) + gh.Distance(p0, q1)
        if dist0 < 1E-6 or dist1 < 1E-6:
            return id

if button:
    topic = Topic("/scaffold/stick_model/", Message)
    tx = MqttTransport(host="localhost")
    publisher = Publisher(topic, transport=tx)
    
    stick_model = {"radius": radius,
    "vertices": [],
    "edges": [],
    "file_name": file_name,
    }
    
    parameters = {
    "fixed_element_ids": [],
    "layers": [],
    "reciprocal": False,
    "bar_available_lengths": [0.3, 0.4],
    'clamp_gap': 0,
    'clamp_collision_dist':2 * radius,
    'pos_devi': 0.04,
    'orient_devi': 0.0872664626,
    'debug_mode': True,
    'time_out': 100
    }
    
    
    
    for line in lines:
        [p0, p1] = gh.EndPoints(line)
        nV = len(stick_model["vertices"])
        stick_model["vertices"].append([x for x in p0])
        stick_model["vertices"].append([x for x in p1])
        stick_model["edges"].append([nV, nV + 1])
    
    remain_inds = range(len(lines))
    
    if layers_lines != None:
    
        for layer in layers_lines:
            layer_ind = []
            for line in layer:
                ind = get_line_id(line, lines)
                layer_ind.append(ind)
                remain_inds.remove(ind)
            parameters["layers"].append(layer_ind)
    if remain_inds != []:
            parameters["layers"].append(remain_inds)
    
    for line in fixed_lines:
        ind = get_line_id(line, lines)
        parameters["fixed_element_ids"].append(ind)
    
    data = {
        "stick_model": stick_model,
        "mt_config": parameters
    }
    
    print(parameters)
    
    msg = Message(data)
    publisher.publish(msg)
    time.sleep(1)
# ---------- end python ----------
len = Length(Curve=L.lines)
cyl = Cylinder(Base=L.lines, Radius=Slider(0.01, range=0..0.01), Length=len)
mesh_highres = Mesh(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)

# ---- group: Viz for computed multi-tangent structure
plane = Plane(L.coupler_planes)
mesh = Mesh(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)
orient = Orient(Geometry=mesh_highres, Source=PlaneXY(0, 0, 0), Target=plane)  # -> Geometry, Transform
custom_preview = CustomPreview(Geometry=cyl, Material=ColourSwatch(SwatchColor=RGB(253, 88, 255)))
custom_preview_2 = CustomPreview(Geometry=orient.Geometry, Material=ColourSwatch(SwatchColor=RGB(145, 146, 148)))
