# Grasshopper definition file_parser.gh (Grasshopper 1.0.7)

panel = Panel("E:\Code\husky_ws\Scaffold\data\mt")
panel_2 = Panel("robarch_peng.json")
ghpython_script = GhPythonScript(path=panel)  # -> out, json_files
# ---------- ghpython_script: Python ----------
import os

def get_json_file_names(path):
    try:
        # List all files in the given path that end with ".json"
        json_files = [
            name for name in os.listdir(path) 
            if os.path.isfile(os.path.join(path, name)) and name.endswith(".json")
        ]
        return json_files
    except ValueError:
        print("Error: The path '{path}' does not exist.")
        return []

# Example usage
json_files = get_json_file_names(path)
# ---------- end ghpython_script ----------
panel_3 = Panel("/Users/wangziqi/Documents/GitHub/Scaffold/data/multi_tangent_data/mt_results/geodesic_dome_nonreciprocal_layer_0_legacy.json")
panel_4 = Panel("/Users/wangziqi/Documents/GitHub/Scaffold/data/multi_tangent_data/mt_results/geodesic_dome_reciprocal_layer_0_legacy.json")
panel_5 = Panel(ghpython_script.json_files)
panel_6 = Panel("/Users/ziqwang/Documents/GitHub/Scaffold/data/multi_tangent_data/mt_results/eleni_layer_0_legacy.json")
list_item = ListItem(List=ghpython_script.json_files, Index=Slider(0, range=0..30), Wrap=True)  # -> flatten(Item)
concatenate = Concatenate(FragmentA=panel, FragmentB=list_item, JoinSeparator="\")
panel_7 = Panel(list_item)
L = GhPythonScript(file_path=concatenate, scale="1")  # -> lines, coupler_planes
# ---------- L: Python ----------
import json
import ghpythonlib.components as gh
import Rhino.Geometry.Plane as Plane
import Rhino.Geometry.Vector3d as Vector3d
import Rhino.Geometry.Point3d as Point3d

with open(file_path) as json_data:
    data = json.load(json_data)

ps = data['line']
lines = []
for p0,p1 in ps:
    a = gh.ConstructPoint(*p0)
    b = gh.ConstructPoint(*p1)
    a *= scale
    b *= scale
    lines.append(gh.Line(a, b))

coupler_planes = []
xyz = [0, 1, 2]
for coupler_data in data['half_couplers']:
    tform = coupler_data['pose']
    plane = Plane(Point3d(*[tform[3][i] * scale for i in xyz]),
                  Vector3d(*[tform[1][i] for i in xyz]),
                  Vector3d(*[tform[0][i] for i in xyz])
                  )
    coupler_planes.append(plane)
# ---------- end L ----------
len = Length(Curve=L.lines)
cyl = Cylinder(Base=L.lines, Radius=Slider(0.01, range=0..0.01), Length=len)
mesh_highres = Mesh(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)

# ---- group: Viz for computed multi-tangent structure
plane = Plane(L.coupler_planes)
mesh = Mesh(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)
orient = Orient(Geometry=mesh_highres, Source=PlaneXY(0, 0, 0), Target=plane)  # -> Geometry, Transform
custom_preview = CustomPreview(Geometry=cyl, Material=ColourSwatch(SwatchColor=RGB(253, 88, 255)))
custom_preview_2 = CustomPreview(Geometry=orient.Geometry, Material=ColourSwatch(SwatchColor=RGB(145, 146, 148)))
