# Grasshopper definition box.gh (Grasshopper 1.0.7)

# ----
# Sender
crv = Curve([<curve referenced from the Rhino model> x192])
crv_2 = Curve(<curve referenced from the Rhino model>)
python = GhPythonScript(lines=crv, radius="0.01", file_name="cshape", fixed_lines=crv_2, button=Button())  # inputs lines: list of Curve, fixed_lines: list of Curve, button: Boolean
# ---------- python: Python ----------
import time
import ghpythonlib.components as gh
from compas_eve import Message
from compas_eve import Publisher
from compas_eve import Topic
from compas_eve.mqtt import MqttTransport


def get_line_id(line, lines):
    [p0, p1] = gh.EndPoints(line)
    
    for id, l in enumerate(lines):
        [q0, q1] = gh.EndPoints(l)
        dist0 = gh.Distance(p0, q0) + gh.Distance(p1, q1)
        dist1 = gh.Distance(p1, q0) + gh.Distance(p0, q1)
        if dist0 < 1E-6 or dist1 < 1E-6:
            return id

if button:
    topic = Topic("/scaffold/stick_model/", Message)
    tx = MqttTransport(host="broker.hivemq.com")
    publisher = Publisher(topic, transport=tx)
    
    stick_model = {"radius": radius,
    "vertices": [],
    "edges": [],
    "file_name": file_name,
    }
    
    parameters = {
    "fixed_element_ids": [],
    "layers": [],
    "reciprocal": False,
    "bar_available_lengths": [1.2],
    'clamp_gap': 0.016,
    'clamp_collision_dist':2 * radius,
    'pos_devi': 0.04,
    'orient_devi': 0.0872664626,
    'debug_mode': False,
    'time_out': 1000
    }
    
    
    
    for line in lines:
        [p0, p1] = gh.EndPoints(line)
        nV = len(stick_model["vertices"])
        stick_model["vertices"].append([x for x in p0])
        stick_model["vertices"].append([x for x in p1])
        stick_model["edges"].append([nV, nV + 1])
    
    remain_inds = range(len(lines))
    
    if layers_lines != None:
    
        for layer in layers_lines:
            layer_ind = []
            for line in layer:
                ind = get_line_id(line, lines)
                layer_ind.append(ind)
                remain_inds.remove(ind)
            parameters["layers"].append(layer_ind)
    if remain_inds != []:
            parameters["layers"].append(remain_inds)
    
    for line in fixed_lines:
        ind = get_line_id(line, lines)
        parameters["fixed_element_ids"].append(ind)
    
    data = {
        "stick_model": stick_model,
        "mt_config": parameters
    }
    
    print(parameters)
    
    msg = Message(data)
    publisher.publish(msg)
    time.sleep(1)
# ---------- end python ----------

len = Length(Curve=crv)
sort = SortList(Keys=len)  # -> Keys, ValuesA
panel = Panel(sort.Keys)

coupler_lowres = Mesh(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)
coupler_highres = Mesh(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)
python_2 = GhPythonScript(lines=crv, radius="0.01")  # -> beams; inputs lines: list of Curve
# ---------- python_2: Python ----------
__author__ = "ziqwang"

import rhinoscriptsyntax as rs
import ghpythonlib.components as gh

beams = []
for l in lines:
    [p0, p1] = gh.EndPoints(l)
    v0 = gh.ConstructPoint(p0[0], p0[1], p0[2])
    v1 = gh.ConstructPoint(p1[0], p1[1], p1[2])
    zaxis = v1 - v0
    length = gh.VectorLength(zaxis)
    plane = gh.PlaneNormal(v0, zaxis)
    cylinder = gh.Cylinder(plane, radius, length)
    beams.append(cylinder)
# ---------- end python_2 ----------
custom_preview = CustomPreview(Geometry=python_2, Material=ColourSwatch(SwatchColor=RGB(3, 2, 3)))  # disabled

# ----
# Receiver
button = Button()
python_3 = GhPythonScript()  # -> update
# ---------- python_3: Python ----------
__author__ = "ziqwang"

import rhinoscriptsyntax as rs

import time
from compas_eve import Message
from compas_eve import Subscriber
from compas_eve import Topic
from compas_eve.mqtt import MqttTransport
result = []
def update(worker):
    topic = Topic("/opt/scaffold_model/", Message)
    tx = MqttTransport("localhost")

    subcriber = Subscriber(topic, callback=lambda msg: globals().update(result=msg), transport=tx)
    subcriber.subscribe()
    globals().update(result = [])
    print("hello")
    N = 100
    for i in range(10000):
        worker.update_result(result)
        worker.display_progress(i / 10000)
        time.sleep(3)
        
    worker.display_message("Done!")

    return result
# ---------- end python_3 ----------
# Visualization
toggle = BooleanToggle(True)

bg_task = BackgroundTask(reset=button, task=python_3, on=toggle)  # -> result; inputs on: Boolean
#   port reset: Resets the background worker.
#   port task: A Python function that will be executed by the background worker. The function does not need to return quickly, it can even have an infinite loop and keep running, it will not block the UI.
#   port on: Turn ON or OFF the background worker.
#   port result: The result of the long-running task.
# ---------- bg_task: Python ----------
"""
Background Task component.

Executes a long-running task in the background, while keeping Grasshopper reactive.

COMPAS EVE v0.3.5
"""

import threading
import scriptcontext as sc

from compas_eve.ghpython import BackgroundWorker
from ghpythonlib.componentbase import executingcomponent as component


DEBUG = False


class BackgroundTaskComponent(component):
    def RunScript(self, reset, task, on):
        if not on:
            BackgroundWorker.stop_instance_by_component(ghenv)  # noqa: F821
            return None

        self.worker = BackgroundWorker.instance_by_component(ghenv, task, force_new=reset)  # noqa: F821

        if not self.worker.is_working() and not self.worker.is_done() and reset:
            self.worker.start_work()

        print("Worker ID: {}".format(id(self.worker)))
        print("Is worker running? {}".format(self.worker.is_working()))
        print("Worker completed? {}".format(self.worker.is_done()))
        if hasattr(self.worker, "thread"):
            print("Worker thread: {}".format(self.worker.thread))

        if DEBUG:
            other_workers = []
            for key in sc.sticky.keys():
                if key.startswith("background_worker_"):
                    worker = sc.sticky[key]
                    if worker != self.worker:
                        other_workers.append(worker)

            if len(other_workers):
                print
                print("Found {} more workers:".format(len(other_workers)))
                for worker in other_workers:
                    print("* Worker ID: {}".format(id(worker)))
                    print(" - Is worker running? {}".format(worker.is_working()))
                    print(" - Worker completed? {}".format(worker.is_done()))
                    print(" - Worker thread: {}".format(worker.thread))

            non_main_threads = [thread for thread in threading.enumerate() if thread.name != "MainThread"]
            if len(non_main_threads):
                print
                print("Found {} background threads running:".format(len(non_main_threads)))
                for thread in non_main_threads:
                    print(" - " + thread.name)

        if hasattr(self.worker, "result"):
            return self.worker.result
        else:
            return None
# ---------- end bg_task ----------

beams = GhPythonScript(json_data=bg_task)  # -> beams, coupler_planes
# ---------- beams: Python ----------
__author__ = "wangziqi"

import rhinoscriptsyntax as rs
import ghpythonlib.components as gh
import Rhino.Geometry.Plane as Plane
import Rhino.Geometry.Vector3d as Vector3d
import Rhino.Geometry.Point3d as Point3d
import json

beams = []
for line_data in json_data["scaffold_model"]["line"]:
    [p0, p1] = line_data
    v0 = gh.ConstructPoint(p0[0], p0[1], p0[2])
    v1 = gh.ConstructPoint(p1[0], p1[1], p1[2])
    zaxis = v1 - v0
    length = gh.VectorLength(zaxis)
    plane = gh.PlaneNormal(v0, zaxis)
    cylinder = gh.Cylinder(plane, json_data['scaffold_model']["radius"], length)
    beams.append(cylinder)
    
coupler_planes = []
xyz = [0, 1, 2]
for coupler_data in json_data["scaffold_model"]['half_couplers']:
    tform = coupler_data['pose']
    plane = Plane(Point3d(*[tform[3][i] for i in xyz]),
                  Vector3d(*[tform[1][i] for i in xyz]),
                  Vector3d(*[tform[0][i] for i in xyz])
                  )
    coupler_planes.append(plane)
# ---------- end beams ----------

custom_preview_2 = CustomPreview(Geometry=beams.beams, Material=ColourSwatch(SwatchColor=RGB(253, 88, 255)))
orient = Orient(Geometry=coupler_highres, Source=PlaneXY(0, 0, 0), Target=beams.coupler_planes)  # -> Geometry, Transform
custom_preview_3 = CustomPreview(Geometry=orient.Geometry, Material=ColourSwatch(SwatchColor=RGB(153, 245, 15)))
