# Grasshopper definition quick_file_viz.gh (Grasshopper 1.0.7)
# plug-ins: Pufferfish

panel = Panel("E:\Code\husky_ws\Scaffold\data\mt")
ghpython_script = GhPythonScript(path=panel)  # -> out, json_files
# ---------- ghpython_script: Python ----------
import os

def get_json_file_names(path):
    try:
        # List all files in the given path that end with ".json"
        json_files = [
            name for name in os.listdir(path) 
            if os.path.isfile(os.path.join(path, name)) and name.endswith(".json")
        ]
        return json_files
    except ValueError:
        print("Error: The path '{path}' does not exist.")
        return []

# Example usage
json_files = get_json_file_names(path)
# ---------- end ghpython_script ----------
panel_2 = Panel("box2x2_peng.json")
panel_3 = Panel(ghpython_script.json_files)
list_item = ListItem(List=ghpython_script.json_files, Index=Slider(0, range=0..7), Wrap=True)  # -> flatten(Item)
concatenate = Concatenate(FragmentA=panel, FragmentB=list_item, JoinSeparator="\")
panel_4 = Panel(concatenate)
ghpython_script_2 = GhPythonScript(file_path=concatenate)  # -> out, lines, radius, contact_lines
# ---------- ghpython_script_2: Python ----------
import Rhino.Geometry.Point3d as Point3d
import Grasshopper.DataTree as DataTree # Add, AddRange(list, GHPath(i, j))
import Grasshopper.Kernel.Data.GH_Path as GHPath
import System
import json
import rhinoscriptsyntax as rs

from ghpythonlib.treehelpers import list_to_tree, tree_to_list

with open(file_path, 'r') as file:
    # Parse the JSON data
    data = json.load(file)

# Create a list of lines based on elements
lines = []
for e in data["line"]:
    start_point = rs.AddPoint(e[0])
    end_point = rs.AddPoint(e[1])
    line = rs.AddLine(start_point, end_point)
    lines.append(line)

#contact_lines = []
#for e in data["contact_pts"]:
#    start_point = rs.AddPoint(e[0])
#    end_point = rs.AddPoint(e[1])
#    line = rs.AddLine(start_point, end_point)
#    contact_lines.append(line)
#    contact_lines.append(start_point)
    
radius = data['radius']
# ---------- end ghpython_script_2 ----------
curve = Curve(ghpython_script_2.contact_lines)
length = Length(Curve=curve)
curve_2 = Curve(ghpython_script_2.lines)
pipe = Pipe(Curve=curve_2, Radius=ghpython_script_2.radius, Caps=0)
smaller_than = SmallerThan(FirstNumber=length, SecondNumber=0.019)  # -> SmallerThan, OrEqualTo
list_indices = ListIndices(List=length)
dispatch = Dispatch(List=list_indices, DispatchPattern=smaller_than.SmallerThan)  # -> ListA, ListB
list_item_2 = ListItem(List=curve, Index=dispatch.ListA, Wrap=True)
panel_5 = Panel(dispatch.ListA)
end_points = EndPoints(Curve=list_item_2)  # -> Start, End
dot_display = DotDisplay(Point=end_points.Start, Colour=RGB(0, 0, 0), Size=Slider(0.02, range=0..0.1))
