# Grasshopper definition reciprocal.gh (Grasshopper 1.0.7)
# plug-ins: Kangaroo2 Components

random_seed = Slider(1749, range=0..10000)
brep = Brep(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)
point_shell = PointShell(spacing="0.3", seed=random_seed, G=brep)
mesh = MeshBrep(
    Brep=brep,
    Settings={GridMaxCount=0, GridMinCount=16, JaggedSeams=False, MaxEdgeLength=0, MinEdgeLength=0.0001, MinTolerance=0, Refine=True, RefineAngle=0, RelativeTolerance=0.65, SimplePlanes=True, Tolerance=0})
voronoi³ = Voronoi3D(Points=point_shell)  # -> Cells, Boundary
bbx = BrepBrep(BrepA=voronoi³.Cells, BrepB=brep)  # -> Curves, Points
explode = Explode(Curve=flatten(bbx.Curves), Recursive=True)  # -> flatten(Segments), Vertices
end = EndPoints(Curve=explode.Segments)  # -> Start, End
ln = Line(StartPoint=end.Start, EndPoint=end.End)
dupln = RemoveDuplicateLines(Lines=ln, Tolerance=0.01)
# Send
reciprocal = GhPythonScript(lines=dupln, Surface=brep, radius="0.01", file_name="box", button=Button())  # inputs lines: list of Curve, Surface: Surface, fixed_lines: list of Curve, button: Boolean
# ---------- reciprocal: Python ----------
import time
import ghpythonlib.components as gh
from compas_eve import Message
from compas_eve import Publisher
from compas_eve import Topic
from compas_eve.mqtt import MqttTransport


def get_line_id(line, lines):
    [p0, p1] = gh.EndPoints(line)
    
    for id, l in enumerate(lines):
        [q0, q1] = gh.EndPoints(l)
        dist0 = gh.Distance(p0, q0) + gh.Distance(p1, q1)
        dist1 = gh.Distance(p1, q0) + gh.Distance(p0, q1)
        if dist0 < 1E-6 or dist1 < 1E-6:
            return id

if button:
    topic = Topic("/scaffold/stick_model/", Message)
    tx = MqttTransport(host="localhost")
    publisher = Publisher(topic, transport=tx)

    stick_model = {
    "radius": 0.01,
    "vertices": [],
    "edges": [],
    "file_name": file_name,
    "normals": []
    }
    
    parameters = {
    "layers": [],
    "fixed_element_ids": [],
    "reciprocal": True
    }
    
    
    for line in lines:
        [p0, p1] = gh.EndPoints(line)
        for pt in [p0, p1]:
            _, uv, _ = gh.SurfaceClosestPoint(pt, Surface)
            F, _, _ = gh.SurfaceCurvature(Surface, uv)
            stick_model["normals"].append([-x for x in F.ZAxis])
        
        nV = len(stick_model["vertices"])
        
        stick_model["vertices"].append([x for x in p0])
        stick_model["vertices"].append([x for x in p1])
        
        
        stick_model["edges"].append([nV, nV + 1])
    
    remain_inds = range(len(lines))
    
    if layers_lines != None:
    
        for layer in layers_lines:
            layer_ind = []
            for line in layer:
                ind = get_line_id(line, lines)
                layer_ind.append(ind)
                remain_inds.remove(ind)
            parameters["layers"].append(layer_ind)
            
    if remain_inds != []:
            parameters["layers"].append(remain_inds)
    
    for line in fixed_lines:
        ind = get_line_id(line, lines)
        parameters["fixed_element_ids"].append(ind)
    
        
    data = {
    "stick_model": stick_model,
    "mt_config": parameters
    }
    
    print(data)
    
    msg = Message(data)
    publisher.publish(msg)
    time.sleep(1)
# ---------- end reciprocal ----------

# ==== cluster PointShell
spacing = ClusterInput()
seed = ClusterInput()
G = ClusterInput()
area = Area(Geometry=G)  # -> Area, Centroid
expression = Expression(spacing=spacing, area=area.Area, Expression="Round(area/(3^0.5/2 * spacing^2),0)")
popgeo = PopulateGeometry(Geometry=G, Count=expression, Seed=seed)
points = ClusterOutput(popgeo)
