# Grasshopper definition xue.gh (Grasshopper 1.0.7)
# plug-ins: Kangaroo2 Components

mesh = Mesh(<mesh referenced from the Rhino model>)
faceb = FaceBoundaries(Mesh=mesh)
explode = Explode(Curve=faceb, Recursive=True)  # -> flatten(Segments), Vertices
line = Line(explode.Segments)
dupln = RemoveDuplicateLines(Lines=line, Tolerance=0.01)
scale = Scale(Geometry=dupln, Center=Point(0, 0, 0), Factor="0.001")  # -> Geometry, Transform
geometry = Geometry(flatten(scale.Geometry))
item = ListItem(List=geometry, Index=0, Wrap=True)
crv = Curve(item)
crv_2 = Curve(geometry)
# Send
python = GhPythonScript(lines=crv_2, radius="0.01", file_name="xue", fixed_lines=crv, button=Button())  # inputs lines: list of Curve, fixed_lines: list of Curve, button: Boolean
# ---------- python: Python ----------
import time
import ghpythonlib.components as gh
from compas_eve import Message
from compas_eve import Publisher
from compas_eve import Topic
from compas_eve.mqtt import MqttTransport


def get_line_id(line, lines):
    [p0, p1] = gh.EndPoints(line)
    
    for id, l in enumerate(lines):
        [q0, q1] = gh.EndPoints(l)
        dist0 = gh.Distance(p0, q0) + gh.Distance(p1, q1)
        dist1 = gh.Distance(p1, q0) + gh.Distance(p0, q1)
        if dist0 < 1E-6 or dist1 < 1E-6:
            return id

if button:
    topic = Topic("/scaffold/stick_model/", Message)
    tx = MqttTransport(host="localhost")
    publisher = Publisher(topic, transport=tx)
    
    stick_model = {"radius": radius,
    "vertices": [],
    "edges": [],
    "file_name": file_name,
    }
    
    parameters = {
    "fixed_element_ids": [],
    "layers": [],
    "reciprocal": False,
    "bar_available_lengths": [1.0, 2.0],
    'clamp_gap': 0,
    'clamp_collision_dist':2 * radius,
    'pos_devi': 0.04,
    'orient_devi': 0.0872664626,
    'debug_mode': True,
    'time_out': 100
    }
    
    
    
    for line in lines:
        [p0, p1] = gh.EndPoints(line)
        nV = len(stick_model["vertices"])
        stick_model["vertices"].append([x for x in p0])
        stick_model["vertices"].append([x for x in p1])
        stick_model["edges"].append([nV, nV + 1])
    
    remain_inds = range(len(lines))
    
    if layers_lines != None:
    
        for layer in layers_lines:
            layer_ind = []
            for line in layer:
                ind = get_line_id(line, lines)
                layer_ind.append(ind)
                remain_inds.remove(ind)
            parameters["layers"].append(layer_ind)
    if remain_inds != []:
            parameters["layers"].append(remain_inds)
    
    for line in fixed_lines:
        ind = get_line_id(line, lines)
        parameters["fixed_element_ids"].append(ind)
    
    data = {
        "stick_model": stick_model,
        "mt_config": parameters
    }
    
    print(parameters)
    
    msg = Message(data)
    publisher.publish(msg)
    time.sleep(1)
# ---------- end python ----------
